# Dynamo graph Fabrication Renumber V2.3_script.dyn (Dynamo 2.3.2.15696)
# packages: Data-Shapes 2022.2.103, Rhythm 2020.1.24

boolean = BoolSelector(true)
code_block = CodeBlock()
# ---------- code_block.designscript (31 lines) ----------
//[0]  CutType
//[1]  Material
//[2]  Specification
//[3]  InsulationSpecification
//[4]  MaterialGauge
//[5]  DuctFacing
//[6]  Insulation
//[7]  Notes
//[8]  Filename
//[9]  Description
//[10] CID
//[11] SkinMaterial
//[12] SkinGauge
//[13] Section
//[14] Status
//[15] Service
//[16] Pallet
//[17] BoxNo
//[18] OrderNo
//[19] Drawing
//[20] Zone
//[21] ETag
//[22] Alt
//[23] Spool
//[24] Alias
//[25] PCFKey
//[26] CustomData
//[27] ButtonAlias

//If no input is given, a default list of 28 "false"
//values is used, which means all 28 fields are compared.
# ----------------------------------------

# group: Gets all Hanger numbers in Active View and takes the largest number
categories = Categories("OST_FabricationHangers")
current = Document.Current()
activeView = Document.ActiveView(document=current)
all_elements_of_category_in_view = ElementsOfCategoryInView(Category=categories, View=activeView)
code_block_2 = CodeBlock { "Item Number"; }
getParameterValueByName = Element.GetParameterValueByName(element=all_elements_of_category_in_view, parameterName=code_block_2)
code_block_3 = CodeBlock { "0"; }
code_block_4 = CodeBlock { 1; }

length = String.Length(str=getParameterValueByName)
maximumItem = List.MaximumItem(list=length)

# group (continued): Gets all Hanger numbers in Active View and takes the largest number
padLeft = String.PadLeft(str=getParameterValueByName, newWidth=maximumItem, padChars=code_block_3)
maximumItem_2 = List.MaximumItem(list=padLeft)
toNumber = String.ToNumber(str=maximumItem_2)
add = toNumber + code_block_4
string_from_object = FromObject(obj=add)

# group: UI
code_block_5 = CodeBlock { "Fabrication Renumber"; }
file_path = Filename("..\..\..\MurrayTools.tab\Utilities.panel\DatabaseUpdate.pushbutton\Icon.png")
code_block_6 = CodeBlock { "Renumber"; }
code_block_7 = CodeBlock { "Select Elements"; }
selectmodelelements_data = Custom[SelectModelElements Data](InputName=code_block_7)  # package Data-Shapes; Creates a Revit element selection input for UI.MultipleInputForm++ . Check out www.data-shapes.net for more infos!
code_block_8 = CodeBlock { "Prefix"; }
boolean_2 = BoolSelector(false)
textbox_data = Custom[TextBox Data](InputName=code_block_8, IsNumberEntry=boolean_2)  # package Data-Shapes; Create Data for TextBox input in UI.MultipleInputForm ++ . Check out www.data-shapes.net for more informations
code_block_9 = CodeBlock { "Separator"; }
textbox_data_2 = Custom[TextBox Data](InputName=code_block_9, IsNumberEntry=boolean_2)
code_block_10 = CodeBlock { "Number"; }
textbox_data_3 = Custom[TextBox Data](InputName=code_block_10, DefaultText=string_from_object, IsNumberEntry=boolean_2)
boolean_3 = BoolSelector(true)
code_block_11 = CodeBlock { "Cancel"; }
code_block_12 = CodeBlock { 500; }
code_block_13 = CodeBlock { 200; }

code_block_14 = CodeBlock { "Last Used"; }
textbox_data_4 = Custom[TextBox Data](InputName=code_block_14, DefaultText=maximumItem_2, IsNumberEntry=boolean_2, lacing=Shortest)

# group (continued): UI
list_create = List.Create(item0=selectmodelelements_data, item1=textbox_data, item2=textbox_data_2, item3=textbox_data_3, item4=textbox_data_4)
renumber = Custom[Renumber](Description_optional=code_block_5, Logo_optional=file_path, ButtonText_optional=code_block_6, Inputs=list_create, Toggle=boolean_3, CancelButtonText_optional=code_block_11, MaxHeight_optional=code_block_12, Width_optional=code_block_13)  # package Data-Shapes; Create a form with multiple inputs. see www.data-shapes.net for tutorials and infos!

code_block_15 = CodeBlock { 0; }
getItemAtIndex = List.GetItemAtIndex(list=renumber.User_Inputs, index=code_block_15)
categories_2 = Categories("OST_FabricationHangers")
code_block_16 = CodeBlock { "Equals"; }
ʳʰʸᵗʰᵐ_elementfilter_bycategory = Rhythm.Revit.ElementFilter.ElementFilter.ByCategory(elements=getItemAtIndex, category=categories_2, filterMethod=code_block_16)
categories_3 = Categories("OST_FabricationPipework")
ʳʰʸᵗʰᵐ_elementfilter_bycategory_2 = Rhythm.Revit.ElementFilter.ElementFilter.ByCategory(elements=getItemAtIndex, category=categories_3, filterMethod=code_block_16)
categories_4 = Categories("OST_FabricationDuctwork")
ʳʰʸᵗʰᵐ_elementfilter_bycategory_3 = Rhythm.Revit.ElementFilter.ElementFilter.ByCategory(elements=getItemAtIndex, category=categories_4, filterMethod=code_block_16)
list_create_2 = List.Create(item0=ʳʰʸᵗʰᵐ_elementfilter_bycategory, item1=ʳʰʸᵗʰᵐ_elementfilter_bycategory_2, item2=ʳʰʸᵗʰᵐ_elementfilter_bycategory_3)
flatten = List.Flatten(list=list_create_2)
count = List.Count(list=flatten)
code_block_17 = CodeBlock { 1; }
gt = count > code_block_17  # lacing=Shortest
boolean_4 = BoolSelector(false)
list_create_3 = List.Create(item0=boolean_4, item1=boolean_4, item2=boolean_4, item3=boolean_4, item4=boolean_4, item5=boolean_4, item6=boolean_4, item7=boolean_4, item8=boolean_4, item9=boolean_4, item10=boolean_4, item11=boolean_4, item12=boolean_4, item13=boolean_4, item14=boolean_4, item15=boolean_4, item16=boolean_4, item17=boolean_4, item18=boolean_4, item19=boolean_4, item20=boolean_4, item21=boolean_4, item22=boolean_4, item23=boolean_4, item24=boolean_4, item25=boolean_4, item26=boolean_4, item27=boolean_4)
isSameAs = Custom[FabricationPart.IsSameAs](FabricationParts=flatten, ignoreFields=list_create_3)  # Groups FabricationParts into sublists of identical parts, as determined by optional ignoreFields.
if_ = If(test=gt, true=isSameAs, false=flatten)
code_block_18 = CodeBlock { "Item Number"; }
code_block_19 = CodeBlock { 1; }
getItemAtIndex_2 = List.GetItemAtIndex(list=renumber.User_Inputs, index=code_block_19)
code_block_20 = CodeBlock { 2; }
getItemAtIndex_3 = List.GetItemAtIndex(list=renumber.User_Inputs, index=code_block_20)
code_block_21 = CodeBlock { 3; }
getItemAtIndex_4 = List.GetItemAtIndex(list=renumber.User_Inputs, index=code_block_21)
toNumber_2 = String.ToNumber(str=getItemAtIndex_4)
code_block_22 = CodeBlock { 1; }
sequence = Sequence(start=toNumber_2, amount=count, step=code_block_22)
string_from_object_2 = FromObject(obj=sequence)
length_2 = String.Length(str=getItemAtIndex_4)
code_block_23 = CodeBlock { "0"; }
padLeft_2 = String.PadLeft(str=string_from_object_2, newWidth=length_2, padChars=code_block_23)
code_block_24 = CodeBlock(PREFIX=getItemAtIndex_2, SEPARATOR=getItemAtIndex_3, NUMBER=padLeft_2) { PREFIX+SEPARATOR+NUMBER; }
setParameterByName = Element.SetParameterByName(element=if_, parameterName=code_block_18, value=code_block_24)
count_2 = List.Count(list=if_)  # frozen
code_block_25 = CodeBlock { "Last Number Used"; }  # frozen
takeItems = List.TakeItems(list=code_block_24)  # frozen; unwired: amount
code_block_26 = CodeBlock { -1; }  # frozen
takeItems_2 = List.TakeItems(list=takeItems, amount=code_block_26)
ʳʰʸᵗʰᵐ_helpers_simpleusermessage = Rhythm.Revit.Helpers.Helpers.SimpleUserMessage(caption=code_block_25, message=takeItems_2)
